# Grasshopper definition SidewalkEval_Demo.gh (Grasshopper 1.0.7)
# plug-ins: SidewalkEvaluation

# ---- group: User defined region of interest
curve = Curve(<curve referenced from the Rhino model>)

# ---- group: initial building footprints
curve_2 = Curve([<curve referenced from the Rhino model> x1709])

# ---- group: Initial sidewalk curves
curve_3 = Curve([<curve referenced from the Rhino model> x431])

# ---- group: CSV path for NYC Trees dataset
file_path = FilePath("D:\OneDrive\Education\Professional\_Applications\2021 - KPF UI\Code Challenge\Resources\2015_Street_Tree_Census_-_Tree_Data.csv")

# ----
nyc_trees = NYCTrees(CSV_Path=file_path, X_Index="39", Y_Index="40", DBH_Index="3", Borough_Index="29", Borough=0, RegionCurve=curve)  # disabled

prepare_sidewalks = PrepareSidewalks(SidewalkCurves=curve_3, BuildingCurves=curve_2, RegionCurve=curve)  # -> Sidewalks, BuildingClusters; disabled
capacity_utilization = Slider(3, range=0..100)
subway_influence = Slider(1.7, range=1..2)
cleaned_sidewalks = Curve(prepare_sidewalks.Sidewalks)
cleaned_buildings = Curve(prepare_sidewalks.BuildingClusters)
subway_entry = Curve([<curve referenced from the Rhino model> x128])
loaded_trees = Curve(nyc_trees)
evaluate = Evaluate(
    Sidewalk_Curves=cleaned_sidewalks,
    Building_Curves=cleaned_buildings,
    Social_Radius=Slider(1, range=0..10),
    Trees=loaded_trees,
    Subway=subway_entry,
    Subway_Influence=subway_influence,
    Capacity_Utilization=capacity_utilization,
    Tags_Color=ColourSwatch(SwatchColor=RGB(0, 255, 0)),
    Sidewalks_Color=ColourSwatch(SwatchColor=RGB(0, 255, 255)))  # -> Sidewalks_T, Buildings_T, Counts_T; disabled
