# Grasshopper definition Testing.gh (Grasshopper 1.0.7)
# plug-ins: SidewalkEvaluation

region = Curve(<curve referenced from the Rhino model>)

panel = Panel("40")  # disabled
panel_2 = Panel("3")  # disabled
panel_3 = Panel("29")  # disabled
panel_4 = Panel("39")  # disabled
path = FilePath("D:\OneDrive\Github\Sidewalk_Evaluation\Sidewalk_Evaluation\Testing\2015_Street_Tree_Census_-_Tree_Data.csv")  # disabled
T = NYCTrees(CSV_Path=path, X_Index=panel_4, Y_Index=panel, DBH_Index=panel_2, Borough_Index=panel_3, Borough=0, RegionCurve=region)  # disabled
crv = Curve(T)  # disabled

crv_2 = Curve([<curve referenced from the Rhino model> x369])  # disabled
crv_3 = Curve([<curve referenced from the Rhino model> x1552])  # disabled
psw = PrepareSidewalks(SidewalkCurves=crv_2, BuildingCurves=crv_3, RegionCurve=region)  # -> ROW, Interior; disabled
